# Grasshopper definition assignment-01.gh (Grasshopper 1.0.8)

n_point = Slider(60, range=1..500)
seed = Slider(464, range=1..1000)

x_max = Slider(500, range=1..500)
y_max = Slider(500, range=1..500)
z_max = Slider(100, range=1..100)

y_min = Slider(1, range=1..100)
x_min = Slider(1, range=1..200)
z_min = Slider(200, range=1..200)

# ----
# POINT CLOUD GENERATION WITH RANDOMIZER
python_3_script = Python3Script(x_min=x_min, y_min=y_min, z_min=z_min, x_max=x_max, y_max=y_max, z_max=z_max, n_points=n_point, seed_value=seed)  # -> a
# ---------- python_3_script: Python ----------
"""Small Rhino/Grasshopper helpers for generating Bauhaus-inspired geometry."""

from itertools import count
import random

try:
    import Rhino.Geometry as rg
except ImportError:  # pragma: no cover - Rhino is available in Grasshopper runtime.
    rg = None


class _FallbackPoint3d:
    """Very small stand-in used when Rhino is not available."""

    def __init__(self, x, y, z):
        self.x = float(x)
        self.y = float(y)
        self.z = float(z)

    def __iter__(self):
        return iter((self.x, self.y, self.z))

    def __repr__(self):
        return f"Point3d({self.x}, {self.y}, {self.z})"


class _FallbackPointCloud(list):
    """List-like point cloud used when Rhino.Geometry is unavailable."""

    def __init__(self, points=None):
        super().__init__(points or [])

    def Add(self, point):
        self.append(point)


def _as_min_max(domain):
    """Normalize a domain into two 3D corner points."""
    if domain is None:
        return (0.0, 0.0, 0.0), (10.0, 10.0, 10.0)

    if rg is not None:
        if isinstance(domain, rg.Box):
            bbox = domain.BoundingBox
            return (bbox.Min.X, bbox.Min.Y, bbox.Min.Z), (bbox.Max.X, bbox.Max.Y, bbox.Max.Z)
        if isinstance(domain, rg.BoundingBox):
            return (domain.Min.X, domain.Min.Y, domain.Min.Z), (domain.Max.X, domain.Max.Y, domain.Max.Z)

    if hasattr(domain, "Min") and hasattr(domain, "Max"):
        min_point = domain.Min
        max_point = domain.Max
        return (min_point.X, min_point.Y, min_point.Z), (max_point.X, max_point.Y, max_point.Z)

    if isinstance(domain, (list, tuple)) and len(domain) == 2:
        a, b = domain
        if hasattr(a, "X") and hasattr(b, "X"):
            return (a.X, a.Y, a.Z), (b.X, b.Y, b.Z)
        if hasattr(a, "x") and hasattr(b, "x"):
            return (a.x, a.y, a.z), (b.x, b.y, b.z)
        if len(a) == 3 and len(b) == 3:
            return tuple(a), tuple(b)

    if isinstance(domain, (list, tuple)) and len(domain) == 6:
        min_x, min_y, min_z, max_x, max_y, max_z = domain
        return (min_x, min_y, min_z), (max_x, max_y, max_z)

    raise TypeError(
        "domain must be a Rhino Box/BoundingBox, a pair of 3D points, or a "
        "(min_x, min_y, min_z, max_x, max_y, max_z) tuple."
    )


def create_random_point_cloud(domain=None, count=100, seed=None):
    """Create a random point cloud within a rectangular domain.

    domain : Rhino.Geometry.Box | Rhino.Geometry.BoundingBox | tuple
        A 3D domain defined by its minimum and maximum corners. If omitted,
        a 10x10x10 box from the origin is used.
    count  : int
        Number of points to generate.
    seed   : int or None
        Optional random seed for reproducible output.

    Returns:
        Rhino.Geometry.PointCloud or a list-like fallback when Rhino is not
        available.
    """
    count = int(count)
    if count < 0:
        raise ValueError("count must be non-negative.")

    min_corner, max_corner = _as_min_max(domain)
    rng = random.Random(seed)

    if rg is not None:
        cloud = rg.PointCloud()
        for _ in range(count):
            x = rng.uniform(min_corner[0], max_corner[0])
            y = rng.uniform(min_corner[1], max_corner[1])
            z = rng.uniform(min_corner[2], max_corner[2])
            cloud.Add(rg.Point3d(x, y, z))
        return cloud

    points = []
    for _ in range(count):
        x = rng.uniform(min_corner[0], max_corner[0])
        y = rng.uniform(min_corner[1], max_corner[1])
        z = rng.uniform(min_corner[2], max_corner[2])
        points.append(_FallbackPoint3d(x, y, z))
    return _FallbackPointCloud(points)

import sys

library_path = r"C:\Users\lily-\OneDrive - Université Laval\01 - ARC S5\CDF1\01_WORKSPACE\cdf1_teaching\src"
if library_path not in sys.path:
    sys.path.append(library_path)

from cdf.bauhaus import create_random_point_cloud

domain = (x_min, y_min, z_min, x_max, y_max, z_max)
a = create_random_point_cloud(domain, n_points, seed_value)
# ---------- end python_3_script ----------

point_cloud = PointCloud(python_3_script)

seed_2 = Slider(599, range=1..1000)

seed_3 = Slider(455, range=1..1000)  # disabled
number_slider = Slider(1, range=0..1)  # disabled
brep = Brep()  # disabled
radius = Slider(6, range=-1..15)
sphere = Python3Script(r=Slider(6, range=1..10))  # -> out, my_sphere; inputs c: Point3d
# ---------- sphere: Python ----------
import math
import Rhino.Geometry as rg

def create_sphere(center=None, radius=5.0):
    """
    Build a sphere as a Brep.

    center : Rhino.Geometry.Point3d -- the center of the sphere
    radius : float -- the radius of the sphere

    Returns a Rhino.Geometry.Brep.
    """

    if center is None:
        center = rg.Point3d(0, 0, 0)

    sphere = rg.Sphere(center, radius)
    return sphere.ToBrep()

# call function
my_sphere = create_sphere(center=c, radius=r)
# ---------- end sphere ----------
swatch = ColourSwatch(SwatchColor=RGB(87, 106, 255))  # disabled
python_3_script_2 = Python3Script(shapes=brep, swatch=swatch, variation=number_slider, seed=seed_3)  # -> a; inputs shapes: list; disabled
# ---------- python_3_script_2: Python ----------
import sys
import importlib

library_path = r"C:\Users\lily-\OneDrive - Université Laval\01 - ARC S5\CDF1\01_WORKSPACE\cdf1_teaching\src"
if library_path not in sys.path:
    sys.path.append(library_path)

import cdf.bauhaus as bauhaus
importlib.reload(bauhaus)

a = bauhaus.randomize_shape_colors(
    shapes,
    base_color=swatch,
    variation=variation,
    seed=seed
)
# ---------- end python_3_script_2 ----------
python_3_script_3 = Python3Script(r=radius)  # -> a; inputs pc: PointCloud
# ---------- python_3_script_3: Python ----------
import sys

library_path = r"C:\Users\lily-\OneDrive - Université Laval\01 - ARC S5\CDF1\01_WORKSPACE\cdf1_teaching\src"
if library_path not in sys.path:
    sys.path.append(library_path)

from cdf.bauhaus import create_sphere

a = [
    create_sphere(center=pc[i].Location, radius=float(r))
    for i in range(pc.Count)
]
# ---------- end python_3_script_3 ----------
preview = CustomPreview(Geometry=brep, Material=python_3_script_2)  # disabled
brep_2 = Brep(python_3_script_3)

# ----
# CUBE AND SPHERE PARAMETERS
python_3_script_4 = Python3Script(
    pc=point_cloud,
    cube_length=Slider(45, range=-1..45),
    cube_width=Slider(45, range=-1..45),
    cube_height=Slider(5, range=-1..45),
    sphere_radius=Slider(35, range=-1..45),
    seed=seed_2)  # -> a; inputs pc: PointCloud
# ---------- python_3_script_4: Python ----------
import sys

library_path = r"C:\Users\lily-\OneDrive - Université Laval\01 - ARC S5\CDF1\01_WORKSPACE\cdf1_teaching\src"
if library_path not in sys.path:
    sys.path.append(library_path)

from cdf.bauhaus import create_random_cube_sphere_mix

a = create_random_cube_sphere_mix(
    pc,
    cube_length=cube_length,
    cube_width=cube_width,
    cube_height=cube_height,
    sphere_radius=sphere_radius,
    seed=seed
)
# ---------- end python_3_script_4 ----------

# ---- group: Visualize
preview_2 = CustomPreview(Geometry=sphere.my_sphere, Material=ColourSwatch(SwatchColor=RGB(255, 86, 88)))

# ----
# GRID WIRES AND CUT RULE
python_3_script_5 = Python3Script(
    geometries=flatten(python_3_script_4),
    width=Slider(70, range=-1..1000),
    depth=Slider(500, range=-1..1000),
    height=Slider(315, range=-1..1000),
    u_count=Slider(10, range=0..15),
    v_count=Slider(10, range=0..15),
    clearance=Slider(5, range=0..200),
    tolerance=Slider(0.001, range=0.001..1),
    boundary_tolerance=Slider(100, range=100..500))  # -> cleaned_geometries, grid_points, grid_curves, wires, diagnostics; inputs geometries: list of Brep
# ---------- python_3_script_5: Python ----------
import importlib
import cdf.bauhaus as bauhaus

bauhaus = importlib.reload(bauhaus)

result = bauhaus.create_hanging_system(
    geometries=geometries,
    width=width,
    depth=depth,
    center_x=center_x,
    center_y=center_y,
    height=height,
    u_count=u_count,
    v_count=v_count,
    clearance=clearance,
    tolerance=tolerance,
    boundary_tolerance=boundary_tolerance,
)

cleaned_geometries = result[0]
grid_points = result[1]
grid_curves = result[2]
wires = result[3]
diagnostics = result[4]
# ---------- end python_3_script_5 ----------

custom_preview = CustomPreview(
    Geometry=python_3_script_5.grid_points,
    Material={diffuse=RGB(221, 160, 221), emission=RGB(66, 48, 66), shine=0.5, specular=RGB(255, 255, 255), transparency=0})
panel = Panel(python_3_script_5.diagnostics)
custom_preview_2 = CustomPreview(
    Geometry=python_3_script_5.cleaned_geometries,
    Material={diffuse=RGB(221, 160, 221), emission=RGB(66, 48, 66), shine=0.5, specular=RGB(255, 255, 255), transparency=0})
custom_preview_3 = CustomPreview(
    Geometry=python_3_script_5.grid_curves,
    Material={diffuse=RGB(221, 160, 221), emission=RGB(66, 48, 66), shine=0.5, specular=RGB(255, 255, 255), transparency=0})
pipe = Pipe(Curve=python_3_script_5.wires, Radius=Slider(0.22, range=0.01..10), Caps=0, FitRail=False)
custom_preview_4 = CustomPreview(Geometry=pipe, Material=ColourSwatch(SwatchColor=RGB(56, 19, 19)))

brep_3 = Brep(python_3_script_5.cleaned_geometries)
panel_2 = Panel("COLOR SWATCH RANDOMIZER")

seed_4 = Slider(524, range=1..1000)
swatch_1 = ColourSwatch(SwatchColor=RGB(209, 193, 73))
swatch_3 = ColourSwatch(SwatchColor=RGB(255, 87, 87))
swatch_2 = ColourSwatch(SwatchColor=RGB(87, 106, 255))
python_3_script_6 = Python3Script(shapes=brep_3, blue=swatch_1, red=swatch_2, green=swatch_3, seed=seed_4)  # -> a; inputs shapes: list
# ---------- python_3_script_6: Python ----------
import sys
import importlib

library_path = r"C:\Users\lily-\OneDrive - Université Laval\01 - ARC S5\CDF1\01_WORKSPACE\cdf1_teaching\src"
if library_path not in sys.path:
    sys.path.append(library_path)

import cdf.bauhaus as bauhaus
importlib.reload(bauhaus)

a = bauhaus.randomize_shape_colors(
    shapes,
    palette=[blue, red, green],
    seed=seed
)
# ---------- end python_3_script_6 ----------
preview_3 = CustomPreview(Geometry=brep_3, Material=python_3_script_6)

# ---- group: BAKE
brep_4 = Brep(pipe)

# ----
equality = Equality(FirstNumber=python_3_script_6, SecondNumber=swatch_1)  # -> Equality, Inequality
panel_3 = Panel("SWATCH 1")
equality_2 = Equality(FirstNumber=python_3_script_6, SecondNumber=swatch_2)  # -> Equality, Inequality
panel_4 = Panel("SWATCH 2")
equality_3 = Equality(FirstNumber=python_3_script_6, SecondNumber=swatch_3)  # -> Equality, Inequality
panel_5 = Panel("SWATCH 3")
dispatch = Dispatch(List=python_3_script_5.cleaned_geometries, DispatchPattern=equality.Equality)  # -> ListA, ListB
dispatch_2 = Dispatch(List=python_3_script_5.cleaned_geometries, DispatchPattern=equality_2.Equality)  # -> ListA, ListB
dispatch_3 = Dispatch(List=python_3_script_5.cleaned_geometries, DispatchPattern=equality_3.Equality)  # -> ListA, ListB

# ---- group: BAKE
brep_5 = Brep(dispatch.ListA)

brep_6 = Brep(dispatch_2.ListA)

brep_7 = Brep(dispatch_3.ListA)
