# Grasshopper definition assignment-01_bauhaus_v1.gh (Grasshopper 1.0.8)

n_point = Slider(50, range=1..500)
seed = Slider(281, range=1..1000)

x_max = Slider(81, range=1..500)
y_max = Slider(197, range=1..500)
z_max = Slider(29, range=1..100)

y_min = Slider(1, range=1..100)
x_min = Slider(1, range=1..200)
z_min = Slider(162, range=1..200)

# ----
# POINT CLOUD GENERATION WITH RANDOMIZER
python_3_script = Python3Script(x_min=x_min, y_min=y_min, z_min=z_min, x_max=x_max, y_max=y_max, z_max=z_max, n_points=n_point, seed_value=seed)  # -> a
# ---------- python_3_script: Python ----------
"""Small Rhino/Grasshopper helpers for generating Bauhaus-inspired geometry."""

from itertools import count
import random

try:
    import Rhino.Geometry as rg
except ImportError:  # pragma: no cover - Rhino is available in Grasshopper runtime.
    rg = None


class _FallbackPoint3d:
    """Very small stand-in used when Rhino is not available."""

    def __init__(self, x, y, z):
        self.x = float(x)
        self.y = float(y)
        self.z = float(z)

    def __iter__(self):
        return iter((self.x, self.y, self.z))

    def __repr__(self):
        return f"Point3d({self.x}, {self.y}, {self.z})"


class _FallbackPointCloud(list):
    """List-like point cloud used when Rhino.Geometry is unavailable."""

    def __init__(self, points=None):
        super().__init__(points or [])

    def Add(self, point):
        self.append(point)


def _as_min_max(domain):
    """Normalize a domain into two 3D corner points."""
    if domain is None:
        return (0.0, 0.0, 0.0), (10.0, 10.0, 10.0)

    if rg is not None:
        if isinstance(domain, rg.Box):
            bbox = domain.BoundingBox
            return (bbox.Min.X, bbox.Min.Y, bbox.Min.Z), (bbox.Max.X, bbox.Max.Y, bbox.Max.Z)
        if isinstance(domain, rg.BoundingBox):
            return (domain.Min.X, domain.Min.Y, domain.Min.Z), (domain.Max.X, domain.Max.Y, domain.Max.Z)

    if hasattr(domain, "Min") and hasattr(domain, "Max"):
        min_point = domain.Min
        max_point = domain.Max
        return (min_point.X, min_point.Y, min_point.Z), (max_point.X, max_point.Y, max_point.Z)

    if isinstance(domain, (list, tuple)) and len(domain) == 2:
        a, b = domain
        if hasattr(a, "X") and hasattr(b, "X"):
            return (a.X, a.Y, a.Z), (b.X, b.Y, b.Z)
        if hasattr(a, "x") and hasattr(b, "x"):
            return (a.x, a.y, a.z), (b.x, b.y, b.z)
        if len(a) == 3 and len(b) == 3:
            return tuple(a), tuple(b)

    if isinstance(domain, (list, tuple)) and len(domain) == 6:
        min_x, min_y, min_z, max_x, max_y, max_z = domain
        return (min_x, min_y, min_z), (max_x, max_y, max_z)

    raise TypeError(
        "domain must be a Rhino Box/BoundingBox, a pair of 3D points, or a "
        "(min_x, min_y, min_z, max_x, max_y, max_z) tuple."
    )


def create_random_point_cloud(domain=None, count=100, seed=None):
    """Create a random point cloud within a rectangular domain.

    domain : Rhino.Geometry.Box | Rhino.Geometry.BoundingBox | tuple
        A 3D domain defined by its minimum and maximum corners. If omitted,
        a 10x10x10 box from the origin is used.
    count  : int
        Number of points to generate.
    seed   : int or None
        Optional random seed for reproducible output.

    Returns:
        Rhino.Geometry.PointCloud or a list-like fallback when Rhino is not
        available.
    """
    count = int(count)
    if count < 0:
        raise ValueError("count must be non-negative.")

    min_corner, max_corner = _as_min_max(domain)
    rng = random.Random(seed)

    if rg is not None:
        cloud = rg.PointCloud()
        for _ in range(count):
            x = rng.uniform(min_corner[0], max_corner[0])
            y = rng.uniform(min_corner[1], max_corner[1])
            z = rng.uniform(min_corner[2], max_corner[2])
            cloud.Add(rg.Point3d(x, y, z))
        return cloud

    points = []
    for _ in range(count):
        x = rng.uniform(min_corner[0], max_corner[0])
        y = rng.uniform(min_corner[1], max_corner[1])
        z = rng.uniform(min_corner[2], max_corner[2])
        points.append(_FallbackPoint3d(x, y, z))
    return _FallbackPointCloud(points)

import sys

library_path = r"C:\Users\lily-\OneDrive - Université Laval\01 - ARC S5\CDF1\01_WORKSPACE\cdf1_teaching\src"
if library_path not in sys.path:
    sys.path.append(library_path)

from cdf.bauhaus import create_random_point_cloud

domain = (x_min, y_min, z_min, x_max, y_max, z_max)
a = create_random_point_cloud(domain, n_points, seed_value)
# ---------- end python_3_script ----------

point_cloud = PointCloud(python_3_script)

seed_2 = Slider(599, range=1..1000)

seed_3 = Slider(455, range=1..1000)  # disabled
number_slider = Slider(1, range=0..1)  # disabled
brep = Brep()  # disabled
radius = Slider(6, range=-1..15)
sphere = Python3Script(r=Slider(6, range=1..10))  # -> out, my_sphere; inputs c: Point3d
# ---------- sphere: Python ----------
import math
import Rhino.Geometry as rg

def create_sphere(center=None, radius=5.0):
    """
    Build a sphere as a Brep.

    center : Rhino.Geometry.Point3d -- the center of the sphere
    radius : float -- the radius of the sphere

    Returns a Rhino.Geometry.Brep.
    """

    if center is None:
        center = rg.Point3d(0, 0, 0)

    sphere = rg.Sphere(center, radius)
    return sphere.ToBrep()

# call function
my_sphere = create_sphere(center=c, radius=r)
# ---------- end sphere ----------
swatch = ColourSwatch(SwatchColor=RGB(87, 106, 255))  # disabled
python_3_script_2 = Python3Script(shapes=brep, swatch=swatch, variation=number_slider, seed=seed_3)  # -> a; inputs shapes: list; disabled
# ---------- python_3_script_2: Python ----------
import sys
import importlib

library_path = r"C:\Users\lily-\OneDrive - Université Laval\01 - ARC S5\CDF1\01_WORKSPACE\cdf1_teaching\src"
if library_path not in sys.path:
    sys.path.append(library_path)

import cdf.bauhaus as bauhaus
importlib.reload(bauhaus)

a = bauhaus.randomize_shape_colors(
    shapes,
    base_color=swatch,
    variation=variation,
    seed=seed
)
# ---------- end python_3_script_2 ----------
python_3_script_3 = Python3Script(r=radius)  # -> a; inputs pc: PointCloud
# ---------- python_3_script_3: Python ----------
import sys

library_path = r"C:\Users\lily-\OneDrive - Université Laval\01 - ARC S5\CDF1\01_WORKSPACE\cdf1_teaching\src"
if library_path not in sys.path:
    sys.path.append(library_path)

from cdf.bauhaus import create_sphere

a = [
    create_sphere(center=pc[i].Location, radius=float(r))
    for i in range(pc.Count)
]
# ---------- end python_3_script_3 ----------
preview = CustomPreview(Geometry=brep, Material=python_3_script_2)  # disabled
brep_2 = Brep(python_3_script_3)

# ----
# CUBE AND SPHERE PARAMETERS
python_3_script_4 = Python3Script(
    pc=point_cloud,
    cube_length=Slider(19, range=-1..45),
    cube_width=Slider(21, range=-1..45),
    cube_height=Slider(24, range=-1..45),
    sphere_radius=Slider(17, range=-1..45),
    seed=seed_2)  # -> a; inputs pc: PointCloud
# ---------- python_3_script_4: Python ----------
import sys

library_path = r"C:\Users\lily-\OneDrive - Université Laval\01 - ARC S5\CDF1\01_WORKSPACE\cdf1_teaching\src"
if library_path not in sys.path:
    sys.path.append(library_path)

from cdf.bauhaus import create_random_cube_sphere_mix

a = create_random_cube_sphere_mix(
    pc,
    cube_length=cube_length,
    cube_width=cube_width,
    cube_height=cube_height,
    sphere_radius=sphere_radius,
    seed=seed
)
# ---------- end python_3_script_4 ----------

brep_3 = Brep(python_3_script_4)

seed_4 = Slider(273, range=1..1000)
panel = Panel("BOOLEAN DIFFERENCE RANDOMIZER")
python_3_script_5 = Python3Script(solids=brep_3, probability=Slider(1, range=0..1), seed=seed_4)  # -> a; inputs solids: list of Brep
# ---------- python_3_script_5: Python ----------
import sys
import importlib

library_path = r"C:\Users\lily-\OneDrive - Université Laval\01 - ARC S5\CDF1\01_WORKSPACE\cdf1_teaching\src"
if library_path not in sys.path:
    sys.path.append(library_path)

import cdf.bauhaus as bauhaus
importlib.reload(bauhaus)

a = bauhaus.random_boolean_difference(
    solids,
    probability=probability,
    seed=seed
)
# ---------- end python_3_script_5 ----------

# ---- group: Visualize
preview_2 = CustomPreview(Geometry=sphere.my_sphere, Material=ColourSwatch(SwatchColor=RGB(255, 86, 88)))

# ----
brep_4 = Brep(python_3_script_5)
panel_2 = Panel("COLOR SWATCH RANDOMIZER")

seed_5 = Slider(407, range=1..1000)
python_3_script_6 = Python3Script(
    shapes=python_3_script_5,
    blue=ColourSwatch(SwatchColor=RGB(209, 193, 73)),
    red=ColourSwatch(SwatchColor=RGB(87, 106, 255)),
    green=ColourSwatch(SwatchColor=RGB(255, 87, 87)),
    seed=seed_5)  # -> a; inputs shapes: list
# ---------- python_3_script_6: Python ----------
import sys
import importlib

library_path = r"C:\Users\lily-\OneDrive - Université Laval\01 - ARC S5\CDF1\01_WORKSPACE\cdf1_teaching\src"
if library_path not in sys.path:
    sys.path.append(library_path)

import cdf.bauhaus as bauhaus
importlib.reload(bauhaus)

a = bauhaus.randomize_shape_colors(
    shapes,
    palette=[blue, red, green],
    seed=seed
)
# ---------- end python_3_script_6 ----------
preview_3 = CustomPreview(Geometry=brep_4, Material=python_3_script_6)
